# Grasshopper definition Control_GenePool_by_GH_Python.gh (Grasshopper 1.0.7)
# Copyright: KAJIMA DESIGN

# STEP 3: GenePoolの指定した1パラメーターを変更
genes = GenePool(Decimals=1, Maximum=20, Minimum=1, Value=[3, 3, 3, 3, 3, 3])
# STEP 1~2:GenePoolを操る
genes_2 = GenePool(Decimals=1, Maximum=20, Minimum=1, Value=[20, 20, 20, 20, 20, 20])
python = GhPythonScript(
    G=genes_2,
    minimum=Slider(1, range=0..20),
    maximum=Slider(20, range=0..20),
    dec=Slider(1, range=0..20),
    cnt=Slider(6, range=1..20),
    df=Slider(3, range=0..20),
    df_update=Button(),
    Recom=Button())  # inputs G: list
# ---------- python: Python ----------
"""Provides a scripting component.
    Inputs:
        G: Input GenePool
        minimum: Set GenePool minimum
        maximum: Set GenePool maximum
        dec: Set GenePool Decimals
        cnt: Set GenePool count
        df: Set GenePool defalt
        df_update: Update defalt
        Recom: Recompute
        """

Par = ghenv.Component.Params
gp = Par.Input[0].Sources[0]

gp.Minimum = minimum
gp.Maximum = maximum
gp.Decimals = dec
gp.Count = cnt

if df_update:
    for i in range(gp.Count):
        gp.Value[i] = df

if Recom:
    gp.ExpireSolution(True)
# ---------- end python ----------
python_2 = GhPythonScript(G=genes, index=Slider(2, range=1..20), value=Slider(3, range=0..20), update=Button())  # inputs G: list
# ---------- python_2: Python ----------
"""Provides a scripting component.
    Inputs:
        G: Input GenePool
        index: Set GenePool index
        value: Set GenePool value
        update: Update defalt & Recompute
        """

Par = ghenv.Component.Params
gp = Par.Input[0].Sources[0]

if update:
    gp.Value[index] = value
    gp.ExpireSolution(True)
# ---------- end python_2 ----------
panel = Panel(genes)
panel_2 = Panel(genes_2)
